# Grasshopper definition Pu.gh (Grasshopper 0.9.76)
# plug-ins: Python Interpreter, VirtualWindTunnel

panel = Panel("C:\MeshingPaper\Pu\")
number_slider = Slider(1, range=0..1)
toggle = BooleanToggle(False)
wind_dir = ControlKnob(Decimals=0, Limit=True, Maximum=359, Minimum=0, Range=360, Value=0)
geo = Geometry(<mesh referenced from the Rhino model>)
xz = XZPlane(Origin=Point(-0.0485980799, -4.042677826, 0))
domaincyl = DomainCyl(
    Geometry=geo,
    Directory="C:\MeshingPaper\test\",
    WindDir=wind_dir,
    DivisionsOuterCirc="15",
    DivisionsZ=Slider(28, range=1..100),
    ScaleInnerR=Slider(0.071, range=0..0.8),
    RAM=number_slider,
    CPUs=number_slider,
    Run=toggle)  # -> Out, Domain, Cyl
clean = Clean(Dir="C:\MeshingPaper\test\", Run=Button())
c_script = CSharpScript(p=xz)  # -> out, B, A; inputs b: list of Brep, p: Plane
# ---------- c_script: C# ----------
    double pj = 0;
    A = FindFacades(p, b, out pj);
    B = pj;
# ---------- c_script: C# additional code ----------
  static List<Brep> FindFacades(Plane plane, List<Brep> volumes, out double projectedAreaTotal)
  {
    List<Brep> Facades = new List<Brep>();

    List<double> projectedAreas = new List<double>();
    foreach (Brep b in volumes)
    {
      for (int i = 0; i < b.Faces.Count; i++)
      {
        Vector3d vSurf = b.Faces[i].NormalAt(0.5, 0.5);
        double dot = plane.ZAxis * vSurf;
        if (dot < 0.1) continue;


        Brep face = b.Faces[i].DuplicateFace(false);
        //Print(dot + "");
        Facades.Add(face);

        Vector3d cross = Vector3d.CrossProduct(plane.ZAxis, vSurf);
        double norm = cross.Length;
        double angle = Math.Atan2(norm, dot);

        //Print((angle * 180 / Math.PI) + "");

        double projectedArea = face.GetArea() * Math.Cos(angle);

        projectedAreas.Add(projectedArea);
        //Print(projectedArea + "");
      }
    }
    projectedAreaTotal = projectedAreas.Sum(x => x);

    return Facades;
  }
# ---------- end c_script ----------
python = PythonScript(x=domaincyl.Domain)  # -> out, a
# ---------- python: Python ----------
a = x.refinementCylinder;
# ---------- end python ----------
cellsize = CellSize(Domain=domaincyl.Domain, BlockMeshCellSize="0.0256232426078395", DesiredCellSize="0.00625")
number_slider_2 = Slider(0.1, range=0..5)
number_slider_3 = Slider(2, range=0..10)
panel_2 = Panel(c_script.B)
number_slider_4 = Slider(100, range=0..100)  # disabled
panel_3 = Panel(python.a)
brep = Brep(<brep referenced from the Rhino model>)
panel_4 = Panel(cellsize)
crv = Curve(<curve referenced from the Rhino model>)  # disabled
cluster = Cluster(B=brep, min_edge=number_slider_2, max_edge=number_slider_2)
divide = DivideCurve(Curve=crv, Count=number_slider_4, Kinks=False)  # -> Points, Tangents, Parameters; disabled
mesh = Mesh(
    Domain=domaincyl.Domain,
    AccBuilding=number_slider_3,
    AccFeatures=number_slider_3,
    AccGround=Slider(2, range=0..10),
    Layer=Slider(3, range=0..10),
    Run=toggle)  # -> Out, Domain
toggle_2 = BooleanToggle(False)
number_slider_5 = Slider(0.138, range=0..1)
probes = Probes(Domain=domaincyl.Domain, Points=cluster, PointName=1, Run=toggle_2)
probes_2 = Probes(Domain=domaincyl.Domain, Points=divide.Points, PointName=1, Run=toggle_2)  # disabled
gradient = Gradient(
    LowerLimit=Slider(0, range=0..10),
    UpperLimit=Slider(3, range=0..25),
    Parameter=probes,
    stops=[0: RGB(234, 38, 0), 0.25: RGB(234, 126, 0), 0.5: RGB(254, 244, 84), 0.75: RGB(173, 203, 249), 1: RGB(75, 107, 169)])
abl = ABL(
    Uref=Slider(12, range=0..100),
    Zref=Slider(12, range=0..100),
    Z0=Slider(12, range=0..100),
    ZGround=Slider(0, range=0..100))
multiplication = Multiplication(A=probes, B=number_slider_5)
multiplication_2 = Multiplication(A=probes_2, B=number_slider_5)
simulation = Simulation(
    Domain=mesh.Domain,
    Iterations=Slider(878, range=0..10000),
    WriteInterval=Slider(26, range=0..100),
    KeepTimeSteps=Slider(4, range=0..10),
    Mode=0,
    Bcond=abl,
    Run=Button())
vdisex = VectorDisplayEx(Point=divide.Points, Vector=multiplication_2, Colour=gradient, Width=2)
vdisex_2 = VectorDisplayEx(Point=cluster, Vector=multiplication, Colour=gradient, Width=2)
c_script_2 = CSharpScript(x="C:\MeshingPaper\test\")  # -> out, A; inputs x: String
# ---------- c_script_2: C# ----------
    string workingDir = @"";


    int mode = 0;


    //DA.GetData(0, ref workingDir);
    //DA.GetData(1, ref mode);


    var iter = new List<int>();
    var Ux = new List<double>();
    var Uy = new List<double>();
    var Uz = new List<double>();
    var p1 = new List<double>();
    var p2 = new List<double>();
    var p3 = new List<double>();
    var p4 = new List<double>();
    var omega = new List<double>();
    var k = new List<double>();


    string fullFilePath = x + "log";


    var lines = File.ReadAllLines(fullFilePath);
    //var l = lines[i];
    //if (l.StartsWith("Exec   : simpleFoam")) lines.Parse(l.Split(',')[1].Split('=')[1]));



    int pCnt = 0;

    for (int i = 0; i < lines.Length; i++)
    {
      var l = lines[i];
      if (l.StartsWith("Time =")) iter.Add(int.Parse(l.Replace("Time =", "").Trim()));

      if (l.StartsWith("smoothSolver:  Solving for Ux, Initial residual =")) Ux.Add(double.Parse(l.Split(',')[1].Split('=')[1]));
      if (l.StartsWith("smoothSolver:  Solving for Uy, Initial residual =")) Uy.Add(double.Parse(l.Split(',')[1].Split('=')[1]));
      if (l.StartsWith("smoothSolver:  Solving for Uz, Initial residual =")) Uz.Add(double.Parse(l.Split(',')[1].Split('=')[1]));



      if (l.StartsWith("GAMG:  Solving for p, Initial residual ="))
      {
        if (pCnt == 0) { p1.Add(double.Parse(l.Split(',')[1].Split('=')[1])); pCnt++; }
        else if (pCnt == 1) { p2.Add(double.Parse(l.Split(',')[1].Split('=')[1])); pCnt++; }
        else if (pCnt == 2) { p3.Add(double.Parse(l.Split(',')[1].Split('=')[1])); pCnt++; }
        else if (pCnt == 3) { p4.Add(double.Parse(l.Split(',')[1].Split('=')[1])); pCnt = 0; }
      }

      if (l.StartsWith("smoothSolver:  Solving for omega, Initial residual =")) omega.Add(double.Parse(l.Split(',')[1].Split('=')[1]));
      if (l.StartsWith("smoothSolver:  Solving for k, Initial residual =")) k.Add(double.Parse(l.Split(',')[1].Split('=')[1]));
    }

    System.Text.StringBuilder sb = new System.Text.StringBuilder();
    sb.AppendLine("iter,Ux,Uy,Uz,p,omega,k");
    for (int i = 0; i < Ux.Count; i++)
    {

      sb.AppendLine(iter[i] + "," + Ux[i] + "," + Uy[i] + "," + Uz[i] + "," + p1[i] + "," + omega[i] + "," + k[i]);
    }



    if ( mode == 0) {
      //File.WriteAllText(x + "residuals.csv", sb.ToString());
      //File.WriteAllText(x + "plotter.gnu", "test");
    }
    else
    {
      //File.WriteAllText(x + "residuals.csv", sb.ToString());
      //File.WriteAllText(x + "plotter.gnu", "test");
    }



    System.Diagnostics.ProcessStartInfo psi = new System.Diagnostics.ProcessStartInfo(@"C:\MeshingPaper\test\");
    psi.StartInfo.FileName = "gnuplot.exe";
    psi.Process.StartInfo.Arguments = "plotter.gnu";
    System.Diagnostics.Process p = new System.Diagnostics.Process();
    p.StartInfo = psi;
    p.Start();
# ---------- end c_script_2 ----------
residualwriter = ResidualWriter(WorkingDir="C:\MeshingPaper\test\", Mode=1)

# ==== cluster Cluster
min_edge = ClusterInput()
max_edge = ClusterInput()
B = ClusterInput()
custom_mesh_settings = SettingsCustom(
    StitchSeams=True,
    SimplePlanes=False,
    Refine=True,
    MinCount=16,
    MaxCount=400,
    AspectRatio=20,
    MaxDistance=0,
    MaxAngle=20,
    MinEdge=min_edge,
    MaxEdge=max_edge)
mesh = MeshBrep(Brep=B, Settings=custom_mesh_settings)
demesh = DeconstructMesh(Mesh=mesh)  # -> Vertices, Faces, Colours, Normals
V = ClusterOutput(demesh.Vertices)
