# Grasshopper definition testFile.gh (Grasshopper 0.9.76)
# plug-ins: Python Interpreter, VirtualWindTunnel

panel = Panel("C:\OF2\")  # disabled
number_slider = Slider(10, range=0..100)  # disabled
number_slider_2 = Slider(27836, range=0..64000)  # disabled
number_slider_3 = Slider(1, range=1..8)  # disabled
toggle = BooleanToggle(False)  # disabled
brep = Brep(<brep referenced from the Rhino model>)  # disabled
button = Button()  # disabled
xz = XZPlane(Origin=Point(-0.0485980799, -4.042677826, 0))  # disabled
clean = Clean(Dir=panel, Run=button)  # disabled
domain = Domain(Geometry=brep, Directory=panel, Mode=1, BaseMesh=number_slider, RAM=number_slider_2, CPUs=number_slider_3, Run=toggle)  # -> Out, Domain, Cyl; disabled
c_script = CSharpScript(b=brep, p=xz)  # -> out, B, A; inputs b: list of Brep, p: Plane; disabled
# ---------- c_script: C# ----------
    double pj = 0;
    A = FindFacades(p, b, out pj);
    B = pj;
# ---------- c_script: C# additional code ----------
  static List<Brep> FindFacades(Plane plane, List<Brep> volumes, out double projectedAreaTotal)
  {
    List<Brep> Facades = new List<Brep>();

    List<double> projectedAreas = new List<double>();
    foreach (Brep b in volumes)
    {
      for (int i = 0; i < b.Faces.Count; i++)
      {
        Vector3d vSurf = b.Faces[i].NormalAt(0.5, 0.5);
        double dot = plane.ZAxis * vSurf;
        if (dot < 0.1) continue;


        Brep face = b.Faces[i].DuplicateFace(false);
        //Print(dot + "");
        Facades.Add(face);
        
        Vector3d cross = Vector3d.CrossProduct(plane.ZAxis, vSurf);
        double norm = cross.Length;
        double angle = Math.Atan2(norm, dot);

        //Print((angle * 180 / Math.PI) + "");

        double projectedArea = face.GetArea() * Math.Cos(angle);

        projectedAreas.Add(projectedArea);
        //Print(projectedArea + "");
      }
    }
    projectedAreaTotal = projectedAreas.Sum(x => x);

    return Facades;
  }
# ---------- end c_script ----------
panel_2 = Panel(c_script.B)  # disabled
c_script_2 = CSharpScript(b=brep)  # -> out, B, A; inputs b: Box; disabled
# ---------- c_script_2: C# ----------
    B = b.GetCorners();
# ---------- end c_script_2 ----------
number_slider_4 = Slider(3, range=0..10)  # disabled
python = PythonScript()  # -> out, a, b, c, d, e, f; disabled
# ---------- python: Python ----------
a=x.BBox
b=x.centerGroundBBox
c=x.BBox.Min
d=x.BBox.Max
e=x.dimY
f=x.newBoxDomain.GetCorners
# ---------- end python ----------
toggle_2 = BooleanToggle(False)  # disabled
mesh = Mesh(Domain=domain.Domain, Accuracy=number_slider_4, Run=toggle_2)  # -> Out, Domain; disabled
panel_3 = Panel(python.b)  # disabled
panel_4 = Panel(python.f)  # disabled
panel_5 = Panel(python.a)  # disabled
panel_6 = Panel(python.c)  # disabled
panel_7 = Panel(mesh.Out)  # disabled
number_slider_5 = Slider(5, range=0..10)  # disabled
number_slider_6 = Slider(20, range=0..100)  # disabled
number_slider_7 = Slider(1000, range=0..1000)  # disabled
toggle_3 = BooleanToggle(False)  # disabled
simulation = Simulation(Iterations=number_slider_7, WriteInterval=number_slider_6, KeepTimeSteps=number_slider_5, Run=toggle_3)  # disabled
number_slider_8 = Slider(32, range=1..100)
number_slider_9 = Slider(17, range=1..100)
pt = ConstructPoint(XCoordinate=0, YCoordinate=0, ZCoordinate=0)
neg = Negative(Value=number_slider_9)
xy = XYPlane(Origin=pt)
dom = ConstructDomain(DomainStart=neg, DomainEnd=number_slider_9)
circle = CircleCNR(Center=pt, Normal=Vector(0, 0, 1), Radius=number_slider_8)
rectangle = Rectangle(Plane=xy, XSize=dom, YSize=dom, Radius=0)  # -> Rectangle, Length
Y = UnitY(Factor=number_slider_8)
move = Move(Geometry=pt, Motion=Y)  # -> Geometry, Transform
angle = Panel("15")
division = Division(A="360", B=angle)
number_slider_10 = Slider(2, range=1..100)
series = Series(Start=0, Step=angle, Count=division)
rad = Radians(Degrees=series)
rotate = Rotate(Geometry=move.Geometry, Angle=rad, Plane=xy)  # -> Geometry, Transform
ln = Line(StartPoint=pt, EndPoint=rotate.Geometry)
points = PointList(Points=rotate.Geometry, Size=number_slider_10)
ccx = CurveCurve(CurveA=rectangle.Rectangle, CurveB=ln)  # -> flatten(Points), ParamsA, ParamsB
points_2 = PointList(Points=ccx.Points, Size=number_slider_10)
lng = ListLength(List=ccx.Points)
panel_8 = Panel(series)
panel_9 = Panel("""0
1
2
22
23""")
panel_10 = Panel("""4
5
6
7
8""")
division_2 = Division(A=lng, B="2")
panel_11 = Panel("""12
11
10
14
13""")
panel_12 = Panel("""20
19
18
17
16""")
item = ListItem(List=ccx.Points, Index=panel_10, Wrap=True)
item_2 = ListItem(List=ccx.Points, Index=panel_12, Wrap=True)
item_3 = ListItem(List=ccx.Points, Index=panel_9, Wrap=True)
item_4 = ListItem(List=ccx.Points, Index=panel_11, Wrap=True)
ln_2 = Line(StartPoint=item, EndPoint=item_2)
ln_3 = Line(StartPoint=item_3, EndPoint=item_4)
crossref = CrossReference(ListA=ln_3, ListB=ln_2, CrossMode=1)  # -> ListA, ListB
ccx_2 = CurveCurve(CurveA=crossref.ListA, CurveB=crossref.ListB)  # -> flatten(Points), ParamsA, ParamsB
points_3 = PointList(Points=ccx_2.Points, Size=number_slider_10)
Z = UnitZ(Factor=Slider(10, range=0..10))
# 24
move_2 = Move(Geometry=ccx_2.Points, Motion=Z)  # -> Geometry, Transform
move_3 = Move(Geometry=rotate.Geometry, Motion=Z)  # -> Geometry, Transform
# 25
move_4 = Move(Geometry=ccx.Points, Motion=Z)  # -> Geometry, Transform
fulllist = CSharpScript(
    arcPoints0=rotate.Geometry,
    boxPoints0=ccx.Points,
    gridPoints0=ccx_2.Points,
    arcPoints1=move_3.Geometry,
    boxPoints1=move_4.Geometry,
    gridPoints1=move_2.Geometry)  # -> out, A, B; inputs arcPoints0: list of Point3d, boxPoints0: list of Point3d, gridPoints0: list of Point3d, arcPoints1: list of Point3d, boxPoints1: list of Point3d, gridPoints1: list of Point3d
# ---------- fulllist: C# ----------
    List<Point3d> L = new List<Point3d>();
    List<String> L2 = new List<String>();

    //L = arcPoints0.Concat(boxPoints0).Concat(gridPoints0).ToList();
    //L2 = arcPoints0.Concat(boxPoints0).Concat(gridPoints0).Concat(arcPoints1).Concat(boxPoints1).Concat(gridPoints1).ToList().GetRange(73, 73);
    L = arcPoints0.Concat(boxPoints0).Concat(gridPoints0).Concat(arcPoints1).Concat(boxPoints1).Concat(gridPoints1).ToList();
    A = L;
    //B = L2;


    for (int i = 0; i < L.Count ; i++){
      L2.Add("(" + L[i].X + " " + +L[i].Y + " " + +L[i].Z + ")");
    }
    B = L2;
# ---------- end fulllist ----------
panel_13 = Panel(fulllist.B)
# 25
points_4 = PointList(Points=move_3.Geometry, Size=number_slider_10)
points_5 = PointList(Points=move_2.Geometry, Size=number_slider_10)
points_6 = PointList(Points=move_4.Geometry, Size=number_slider_10)
# faces
# arcs
c_script_3 = CSharpScript(fullList=fulllist.A)  # -> out, A, B, C, D, E; inputs fullList: list of Point3d
# ---------- c_script_3: C# ----------
    Mesh m = new Mesh();
    Mesh n = new Mesh();
    List<String> L1 = new List<String>();
    List<String> L2 = new List<String>();
    List<String> L3 = new List<String>();

    foreach(Point3d xx in fullList) m.Vertices.Add(xx);


    for(int i = 0; i < fullList.Count / 6 - 1 ;i++){
      m.Faces.AddFace(i, i + 1, fullList.Count / 6 + i + 1, fullList.Count / 6 + i);
    }
    //last Face in list
    m.Faces.AddFace(fullList.Count / 6 - 1, 0, fullList.Count / 6, fullList.Count / 6 + fullList.Count / 6 - 1);

    for(int i = 73; i < fullList.Count / 6 - 1 + 73 ;i++){
      m.Faces.AddFace(i, i + 1, fullList.Count / 6 + i + 1, fullList.Count / 6 + i);
    }
    //last Face in list
    m.Faces.AddFace(fullList.Count / 6 - 1 + 73, 73, fullList.Count / 6 + 73, fullList.Count / 6 + fullList.Count / 6 - 1 + 73);


    //arcPoints1.Count - 1


    A = m;

    for(int i = 0; i < fullList.Count / 6;i++){
      L1.Add(m.Faces[i].A.ToString() + " " + m.Faces[i].B.ToString() + " " + m.Faces[i].C.ToString() + " " + m.Faces[i].D.ToString() + " ");
    }

    for(int i = fullList.Count / 6; i < fullList.Count / 6 * 2;i++){
      L2.Add(m.Faces[i].A.ToString() + " " + m.Faces[i].B.ToString() + " " + m.Faces[i].C.ToString() + " " + m.Faces[i].D.ToString());
    }

    for(int i = 0; i < fullList.Count/6;i++){
      L3.Add(m.Faces[i].A.ToString());
      L3.Add(m.Faces[i].B.ToString());
      L3.Add(m.Faces[i].C.ToString());
      L3.Add(m.Faces[i].D.ToString());
    }

    C = L1;
    D = L2;
    E = L3;
# ---------- end c_script_3 ----------
# vertices
concat = Concatenate(FragmentA=c_script_3.C, FragmentB=c_script_3.D)
# blocks
# arc
panel_14 = Panel(concat)
c_script_4 = CSharpScript(arcPoints1=move_3.Geometry, boxPoints1=move_4.Geometry, gridPoints1=move_3.Geometry)  # -> out, A, B; inputs arcPoints1: list, boxPoints1: list, gridPoints1: list
# ---------- c_script_4: C# ----------
    Mesh m = new Mesh();
    Mesh n = new Mesh();


    //foreach(Point3d xx in arcPoints0) m.Vertices.Add(xx);
    //foreach(Point3d xx in boxPoints0) m.Vertices.Add(xx);
    //foreach(Point3d xx in gridPoints0) m.Vertices.Add(xx);
    foreach(Point3d xx in arcPoints1) n.Vertices.Add(xx);
    foreach(Point3d xx in boxPoints1) n.Vertices.Add(xx);
    foreach(Point3d xx in gridPoints1) n.Vertices.Add(xx);


    //for(int i = 0; i < arcPoints0.Count - 1 ;i++){
    //  m.Faces.AddFace(i, i + 1, arcPoints0.Count + i + 1, arcPoints0.Count + i);
    //}
    //last Face in list
    //m.Faces.AddFace(arcPoints0.Count - 1, 0, arcPoints0.Count, arcPoints0.Count + boxPoints0.Count - 1);

    for(int i = 0; i < arcPoints1.Count - 1;i++){
      n.Faces.AddFace(i, i + 1, arcPoints1.Count + i + 1, arcPoints1.Count + i);
    }
    n.Faces.AddFace(arcPoints1.Count - 1 , 0, arcPoints1.Count , arcPoints1.Count + boxPoints1.Count - 1 );


    //arcPoints1.Count - 1



    A = n;




    //for(int i = 0; i < m.Faces.Count;i++){
    //
    //  Print(m.Faces[i].A + " " + m.Faces[i].B + " " + m.Faces[i].C + " " + m.Faces[i].D + " ");

    //}
    for(int i = 0; i < n.Faces.Count;i++){

      Print(n.Faces[i].A + " " + n.Faces[i].B + " " + n.Faces[i].C + " " + n.Faces[i].D + " ");

    }
# ---------- end c_script_4 ----------
c_script_5 = CSharpScript(
    boxPoints0=ccx.Points,
    gridPoints0=ccx_2.Points,
    arcPoints1=move_3.Geometry,
    boxPoints1=move_4.Geometry,
    gridPoints1=move_2.Geometry)  # -> out, A, B; inputs arcPoints0: list of Point3d, boxPoints0: list of Point3d, gridPoints0: list of Point3d, arcPoints1: list of Point3d, boxPoints1: list of Point3d, gridPoints1: list of Point3d
# ---------- c_script_5: C# ----------
    List<Point3d> L = new List<Point3d>();
    List<Point3d> L2 = new List<Point3d>();



    L = boxPoints0.Concat(gridPoints0).Concat(boxPoints1).Concat(gridPoints1).ToList();
    //L2 = arcPoints0.Concat(boxPoints0).Concat(gridPoints0).Concat(arcPoints1).Concat(boxPoints1).Concat(gridPoints1).ToList().GetRange(73, 73);
    //L2 = boxPoints1.Concat(gridPoints1).ToList();
    A = L;
    B = L2;
# ---------- end c_script_5 ----------
# faces
# patches
c_script_6 = CSharpScript(fullList=fulllist.A, arcPoints0=rotate.Geometry, arcPoints1=move_3.Geometry)  # -> out, A, B, C, D; inputs fullList: list of Point3d, arcPoints0: list of Point3d, arcPoints1: list of Point3d
# ---------- c_script_6: C# ----------
    Mesh m = new Mesh();
    //Mesh n = new Mesh();
    List<String> L1 = new List<String>();
    // List<String> L2 = new List<String>();


    //foreach(Point3d xx in arcPoints0) m.Vertices.Add(xx);
    //foreach(Point3d xx in arcPoints1) m.Vertices.Add(xx);
    foreach(Point3d xx in fullList) m.Vertices.Add(xx);


    for(int i = 0; i < fullList.Count / 6 - 1 ;i++){
      m.Faces.AddFace(i, i + 1, fullList.Count / 2 + i + 1, fullList.Count / 2 + i);
    }
    //last Face in list
    m.Faces.AddFace(fullList.Count / 6 - 1, 0, fullList.Count / 2, fullList.Count / 2 + fullList.Count / 6 -1);

    A = m;

    for(int i = 0; i < fullList.Count / 6;i++){
      L1.Add("(" + m.Faces[i].A.ToString() + " " + m.Faces[i].B.ToString() + " " + m.Faces[i].C.ToString() + " " + m.Faces[i].D.ToString() + ")");
    }


    C = L1;
    //D = L2;
# ---------- end c_script_6 ----------
mesh_2 = Mesh(c_script_4.A)
points_7 = PointList(Points=c_script_5.B, Size=number_slider_10)
points_8 = PointList(Points=c_script_5.A, Size=number_slider_10)
panel_15 = Panel(c_script_6.C)
panel_16 = Panel(c_script_6.A)
c_script_7 = CSharpScript(arcPoints1=rotate.Geometry, boxPoints1=ccx.Points, gridPoints1=ccx_2.Points)  # -> out, A, B; inputs arcPoints1: list, boxPoints1: list, gridPoints1: list
# ---------- c_script_7: C# ----------
    Mesh m = new Mesh();
    Mesh n = new Mesh();


    //foreach(Point3d xx in arcPoints0) m.Vertices.Add(xx);
    //foreach(Point3d xx in boxPoints0) m.Vertices.Add(xx);
    //foreach(Point3d xx in gridPoints0) m.Vertices.Add(xx);
    foreach(Point3d xx in arcPoints1) n.Vertices.Add(xx);
    foreach(Point3d xx in boxPoints1) n.Vertices.Add(xx);
    foreach(Point3d xx in gridPoints1) n.Vertices.Add(xx);


  

    for(int i = 0; i < boxPoints1.Count - 1;i++){
      n.Faces.AddFace(i, i + 1, arcPoints1.Count + i + 1, arcPoints1.Count + i);
    }
    n.Faces.AddFace(arcPoints1.Count - 1, 0, arcPoints1.Count, arcPoints1.Count + boxPoints1.Count - 1);


    //arcPoints1.Count - 1



    A = n;




    //for(int i = 0; i < m.Faces.Count;i++){
    //
    //  Print(m.Faces[i].A + " " + m.Faces[i].B + " " + m.Faces[i].C + " " + m.Faces[i].D + " ");

    //}
    for(int i = 0; i < n.Faces.Count;i++){

      Print(n.Faces[i].A + " " + n.Faces[i].B + " " + n.Faces[i].C + " " + n.Faces[i].D + " ");

    }
# ---------- end c_script_7 ----------
panel_17 = Panel("""24
25
49
48
25
26
50
49
26
27
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""")
panel_18 = Panel("""97
98
122
121
98
99
123
122
99
100
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""")
# faces
# box
c_script_8 = CSharpScript(inputGroundVertices=panel_17, inputTopVertices=panel_18, fullList=fulllist.A)  # -> out, A, B, C, D; inputs inputGroundVertices: list of Int32, inputTopVertices: list of Int32, fullList: list of Point3d
# ---------- c_script_8: C# ----------
    List<Point3d> cutList = new List<Point3d>();


    Mesh m = new Mesh();
    //Mesh n = new Mesh();
    //List<String> L1 = new List<String>();
    // List<String> L2 = new List<String>();
    //B = input;

    //cutList = fullList.GetRange(24, 122);
    //cutList.RemoveRange(49, 24);


    foreach(Point3d xx in fullList) m.Vertices.Add(xx);





    for (int i = 0;i < inputTopVertices.Count - 3; i = i + 4){
      m.Faces.AddFace(inputGroundVertices[i], inputGroundVertices[i + 1], inputGroundVertices[i + 2], inputGroundVertices[i + 3]);
    }
    for (int i = 0;i < inputTopVertices.Count - 3; i = i + 4){
       m.Faces.AddFace(inputTopVertices[i], inputTopVertices[i + 1], inputTopVertices[i + 2], inputTopVertices[i + 3]);
     }

    A = m;
    B = cutList;
# ---------- end c_script_8 ----------
# blocks
# box
c_script_9 = CSharpScript(inputGroundFaces=panel_17, inputTopFaces=panel_18)  # -> out, A, B, C, D; inputs inputGroundFaces: list of Int32, inputTopFaces: list of Int32
# ---------- c_script_9: C# ----------
    List<int> m = new List<Int32>();
    List<string> L1 = new List<String>();


    for (int i = 0;i < inputGroundFaces.Count - 3; i = i + 4){
      bool continueLoop = true;
      m.Add(inputGroundFaces[i]);
      m.Add(inputGroundFaces[i + 1]);
      m.Add(inputGroundFaces[i + 2]);
      m.Add(inputGroundFaces[i + 3]);
      while (continueLoop){
        m.Add(inputTopFaces[i]);
        m.Add(inputTopFaces[i + 1]);
        m.Add(inputTopFaces[i + 2]);
        m.Add(inputTopFaces[i + 3]);
        continueLoop = false;
      }
    }


    for(int i = 0; i < inputGroundFaces.Count + inputTopFaces.Count ;i = i + 8){
      L1.Add("(" +m[i].ToString() + " " + m[i + 1].ToString() + " " + m[i + 2].ToString() + " " + m[i + 3].ToString() + " " + m[i + 4].ToString() + " " + m[i + 5].ToString() + " " + m[i + 6].ToString() + " " + m[i + 7].ToString()+ ")");
    }

 

    A = m;
    B = L1;
# ---------- end c_script_9 ----------
points_9 = PointList(Points=fulllist.A, Size=number_slider_10)
points_10 = PointList(Points=fulllist.A, Size=number_slider_10)
panel_19 = Panel(c_script_9.B)
gradient = Gradient(
    LowerLimit=0,
    UpperLimit=1,
    stops=[0: RGB(234, 38, 0), 0.25: RGB(234, 126, 0), 0.463: RGB(254, 244, 84), 0.75: RGB(173, 203, 249), 1: RGB(75, 107, 169)])
panel_20 = Panel(""");
 
 edges           
 (

 );
boundary
(
    test
    {
    type wall;
    faces
	(
    (0 1 25 24)

    );
    }
  

 );

 
mergePatchPairs 
(
);
 
// ************************************************************************* //""")
panel_21 = Panel("""); 

blocks          
(""")
panel_22 = Panel("""/*--------------------------------*- C++ -*----------------------------------*\
| =========                 |                                                 |
| \\      /  F ield         | OpenFOAM: The Open Source CFD Toolbox           |
|  \\    /   O peration     | Version:  2.1.0                                  |
|   \\  /    A nd           | Web:      http://www.OpenFOAM.com               |
|    \\/     M anipulation  |                                                 |
\*---------------------------------------------------------------------------*/

FoamFile
{
    version     2.0;
    format      ascii;
    class       dictionary;
    object      blockMeshDict;
}
// * * * * * * * * * * * * * * * * * * * * * * * * * * * * * * * * * * * * * //
 
convertToMeters 1;
 



//
vertices        
(""")
vdisex = VectorDisplayEx(Colour=gradient, Width=2)
c_script_10 = CSharpScript(x=panel_22, y=panel_13, z=panel_21, v=panel_14, w=panel_19, u=panel_20)  # -> out, A; inputs x: list of String, y: list of String, z: list of String, u: list of String
# ---------- c_script_10: C# ----------
    List<String> L2 = new List<String>();


    L2 = x.Concat(z);
    //.ToString().Concat(z).Concat(u)
    A = L2;
# ---------- end c_script_10 ----------
panel_23 = Panel(c_script_10.A)
