# Grasshopper definition 4_AnnualWindAnalysis.ghx (Grasshopper 1.0.8)
# plug-ins: RhinoCodePluginGH, Eddy3D

# ----
# 0. Download Weather
panel = Panel("https://energyplus-weather.s3.amazonaws.com/asia_wmo_region_2/IND/IND_Ahmedabad.426470_IWEC/IND_Ahmedabad.426470_IWEC.epw")

# ----
# 1. Geometry &
# Boundary Conditions
panel_2 = Panel("""0
45
90
135
180
225
270
315""")

cluster = Cluster_4()

# ----
# 3. Mesh & Simulation
panel_3 = Panel("C:\Eddy3D-Cases\4_AnnualWindAnalysis")

c_script = CSharpScript(url=panel, saveTo=panel_3)  # -> out, epwPath; inputs url: String, saveTo: String
# ---------- c_script: C# ----------
// Grasshopper Script Instance
#region Usings
using System;
using System.Linq;
using System.Collections;
using System.Collections.Generic;
using System.Drawing;
using System.IO;
using System.Net.Http;
using System.Threading.Tasks;

using Rhino;
using Rhino.Geometry;

using Grasshopper;
using Grasshopper.Kernel;
using Grasshopper.Kernel.Data;
using Grasshopper.Kernel.Types;
#endregion

public class Script_Instance : GH_ScriptInstance
{
    private void RunScript(string url, string saveTo, ref object epwPath)
    {
        try
        {
            // Validate inputs
            if (string.IsNullOrWhiteSpace(url))
            {
                Print("URL is invalid.");
                return;
            }

            if (string.IsNullOrWhiteSpace(saveTo) || !Directory.Exists(saveTo))
            {
                Print("Save folder is invalid.");
                return;
            }

            // Extract the file name from the URL
            string fileName = Path.GetFileName(new Uri(url).AbsolutePath);
            if (string.IsNullOrWhiteSpace(fileName))
            {
                Print("Failed to extract file name from URL.");
                return;
            }

            // Construct the full file path
            string filePath = Path.Combine(saveTo, fileName);

            // Check if the file already exists
            if (File.Exists(filePath))
            {
                Print($"File already exists at {filePath}, skipping download.");
                epwPath = filePath;
                return;
            }

            // Execute the asynchronous method synchronously
            Task.Run(async () =>
            {
                await FileDownloader.DownloadFileAsync(url, filePath);
            }).Wait();

            Print($"File downloaded successfully to {filePath}");
            epwPath = filePath;
        }
        catch (Exception ex)
        {
            Print($"Failed to download file: {ex.Message}");
        }
    }
}

public static class FileDownloader
{
    /// <summary>
    /// Asynchronously downloads a file from the specified URL and saves it to the given file path.
    /// </summary>
    /// <param name="url">The URL of the file to download.</param>
    /// <param name="filePath">The local file path to save the downloaded file.</param>
    public static async Task DownloadFileAsync(string url, string filePath)
    {
        // Validate inputs
        if (string.IsNullOrWhiteSpace(url))
            throw new ArgumentException("URL cannot be null or empty.", nameof(url));

        if (string.IsNullOrWhiteSpace(filePath))
            throw new ArgumentException("File path cannot be null or empty.", nameof(filePath));

        // Ensure the directory exists
        var directory = Path.GetDirectoryName(filePath);
        if (!string.IsNullOrEmpty(directory) && !Directory.Exists(directory))
        {
            Directory.CreateDirectory(directory);
        }

        try
        {
            // Download file using HttpClient
            using var httpClient = new HttpClient();
            using var response = await httpClient.GetAsync(url, HttpCompletionOption.ResponseHeadersRead);
            response.EnsureSuccessStatusCode();

            // Save the file
            await using var fileStream = new FileStream(filePath, FileMode.Create, FileAccess.Write, FileShare.None);
            await response.Content.CopyToAsync(fileStream);
        }
        catch (Exception ex)
        {
            Console.WriteLine($"Error downloading file: {ex.Message}");
            throw;
        }
    }
}
# ---------- end c_script ----------
panel_4 = Panel(c_script.out)
abl_flow = ABLFlow(WindDirections=panel_2, Epw=c_script.epwPath)
rset = RunSettings(
    NumberOfIterations="150",
    WriteInterval=20,
    NumberOfTimestepsToKeep=3,
    TurbulenceModel=2,
    RelaxationFactors=2,
    SolutionAndAlgorithmControl=1,
    PotentialFoamInitialization=False,
    AgeOfAir=True,
    NumberOfCPUs="2",
    OperatingSystem=0)
mjoin = MeshJoin(Meshes=cluster)
brep = Brep(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)
probing = Probing(BuildingMesh=mjoin, GroundMesh=brep, TargetCount=Slider(5261, range=0..10000), ConvertQuadsToTriangles=True)
demesh = DeconstructMesh(Mesh=probing)  # -> Vertices, Faces, Colours, Normals

# ----
# 4. Probing points & probing
panel_5 = Panel("ttt")

# ----
# 6. Clean
button = Button()
clean = Clean(Directory=panel_3, Mode=2, Run=button)

# ----
# 2. Simulation Domain
number_slider = Slider(40, range=0..1000)

domaincyl = CylindricalDomain(
    Geometry=cluster,
    BoundaryCondition=abl_flow,
    BlockSize="15",
    SizeOfInnerRectangle=number_slider,
    SizeOfOuterRadius=Slider(519, range=0..1000),
    Height=Slider(80, range=0..1000))  # -> Domain, Mesh

cellsize = CellSize(SimulationDomain=domaincyl.Domain, BlockSize="15", DesiredCellSize=Slider(2, range=0..10))  # -> Accuracy, Accuracy1

mset = MeshSettings(
    AccBuilding=cellsize.Accuracy,
    AccFeatures=cellsize.Accuracy1,
    AccBBox=0,
    AccGround=cellsize.Accuracy,
    MiscSettings=1,
    NumberOfLayers=4,
    Mode=1)
simulation = Simulation(
    SimulationDomain=domaincyl.Domain,
    WorkingDirectory=panel_3,
    MeshSettings=mset,
    RunSettings=rset,
    RunMeshing=Button(),
    MakeTrees=False,
    RunSimulation=Button(),
    runWithBlueCFD=True)
residuals = VisualizeResiduals(Result=simulation, X="0", Y=":", Version=0, Run=Button(), visResiduals=True)
slurm_runner = SLURMRunner(
    Result=simulation,
    ChargeAccount="gts-pkastner3",
    NotificationEmail="patrick.kastner@gatech.edu",
    MemoryPerCPU="10",
    JobDuration="10",
    OpenFOAMLoadCommand="module load openfoam-org/8-mva2-off3dy")
probing_2 = Probing(
    Result=simulation,
    ProbingPoints=demesh.Vertices,
    NameOfInstance=panel_5,
    InterpolationScheme=3,
    NameOfField=0,
    Run=Button())  # -> ProbingPoints, ProbingResult

# ----
# 5. Post-processing
# 5.1. Paraview
# Multi-directional / annual wind vectors
# 5.2. Grasshopper
# Set to -1 for average of entire year (takes 30 s to compute)
dir = Slider(1, range=0..7)
vectors = Data(probing_2.ProbingResult)
points = Data(probing_2.ProbingPoints)
paraview = Paraview(Result=simulation, ParaviewVersion=2, Run=Button())
choose_dir = TreeBranch(Tree=vectors, Path=dir, MaintainPaths=True)
number_slider_2 = Slider(0, range=0..10)
wind_factors = WindFactors(Result=simulation, ProbingPoints=points, WindVelocity=vectors, Run=Button(), Interpolation=True)  # -> WindFactorsSpatial, WindFactorsAnnual
cluster_2 = Cluster(data=choose_dir)  # -> S, E, data_3
gradient = Gradient(
    LowerLimit=cluster_2.S,
    UpperLimit=number_slider_2,
    Parameter=cluster_2.data_3,
    stops=[0.103: RGB(0, 0, 255), 0.22: RGB(0, 170, 255), 0.305: RGB(0, 255, 255), 0.398: RGB(0, 255, 188), 0.504: RGB(0, 255, 106), 0.605: RGB(91, 255, 0), 0.699: RGB(184, 255, 0), 0.799: RGB(255, 255, 0), 0.898: RGB(255, 170, 0)])
panel_6 = Panel("-1")
dedata = DeconstructDataObjects(Data=wind_factors.WindFactorsAnnual, Select=number_slider_2)
flip = FlipMatrix(Data=dedata)
vdisex = VectorDisplayEx(Point=points, Vector=choose_dir, Colour=gradient, Width=Slider(3, range=0..10))  # disabled
avr = Average(Input=flip)  # -> flatten(ArithmeticMean)
cluster_3 = Cluster(data=avr)  # -> S, E, data_3
cluster_4 = Cluster_3(C=points, T=Vector(0, 0, 10))
gradient_2 = Gradient(
    LowerLimit=cluster_3.S,
    UpperLimit=cluster_3.E,
    Parameter=cluster_3.data_3,
    stops=[0.103: RGB(0, 0, 255), 0.22: RGB(0, 170, 255), 0.305: RGB(0, 255, 255), 0.398: RGB(0, 255, 188), 0.504: RGB(0, 255, 106), 0.605: RGB(91, 255, 0), 0.699: RGB(184, 255, 0), 0.799: RGB(255, 255, 0), 0.898: RGB(255, 170, 0)])
preview = CustomPreview(Geometry=cluster_4, Material=gradient_2)

pedestrian_wind_comfort = PedestrianWindComfort(
    WindFactorsSpatial=wind_factors.WindFactorsSpatial,
    WindFactorsAnnual=wind_factors.WindFactorsAnnual,
    WindComfortMetric=1,
    Weibull_Fit=True)  # -> WindComfortRank, WindComfortClassLetter, WindComfortClass

# ----
# Wind Comfort Metrics
vec = Vector(Vector(-271, -230, 0))
cluster_5 = Cluster_3(C=points, T=Vector(0, 0, 10))
cluster_6 = Cluster_3(C=points, T=Vector(0, 0, 10))
pedestrian_wind_comfort_2 = PedestrianWindComfort(
    WindFactorsSpatial=wind_factors.WindFactorsSpatial,
    WindFactorsAnnual=wind_factors.WindFactorsAnnual,
    WindComfortMetric=1,
    Weibull_Fit=True)  # -> WindComfortRank, WindComfortClassLetter, WindComfortClass
move = Move(Geometry=cluster_5, Motion=vec)  # -> flatten(Geometry), Transform
move_2 = Move(Geometry=cluster, Motion=vec)  # -> flatten(Geometry), Transform
move_3 = Move(Geometry=cluster_6, Motion=Vector(-280.6944615, 0, 0))  # -> flatten(Geometry), Transform
move_4 = Move(Geometry=cluster, Motion=Vector(-280.6944615, 0, 0))  # -> flatten(Geometry), Transform
area = Area(Geometry=move.Geometry)  # -> Area, Centroid
area_2 = Area(Geometry=move_3.Geometry)  # -> Area, Centroid
cluster_7 = Cluster(data=pedestrian_wind_comfort.WindComfortRank)  # -> S, E, data_3
tag = TextTag(Location=area_2.Centroid, Text=pedestrian_wind_comfort.WindComfortClassLetter)
cluster_8 = Cluster(data=pedestrian_wind_comfort_2.WindComfortRank)  # -> S, E, data_3
tag_2 = TextTag(Location=area.Centroid, Text=pedestrian_wind_comfort_2.WindComfortClassLetter)
gradient_3 = Gradient(
    LowerLimit=cluster_7.S,
    UpperLimit=cluster_7.E,
    Parameter=cluster_7.data_3,
    stops=[0.103: RGB(0, 0, 255), 0.22: RGB(0, 170, 255), 0.305: RGB(0, 255, 255), 0.398: RGB(0, 255, 188), 0.504: RGB(0, 255, 106), 0.605: RGB(91, 255, 0), 0.699: RGB(184, 255, 0), 0.799: RGB(255, 255, 0), 0.898: RGB(255, 170, 0)])
gradient_4 = Gradient(
    LowerLimit=cluster_8.S,
    UpperLimit=cluster_8.E,
    Parameter=cluster_8.data_3,
    stops=[0.103: RGB(0, 0, 255), 0.22: RGB(0, 170, 255), 0.305: RGB(0, 255, 255), 0.398: RGB(0, 255, 188), 0.504: RGB(0, 255, 106), 0.605: RGB(91, 255, 0), 0.699: RGB(184, 255, 0), 0.799: RGB(255, 255, 0), 0.898: RGB(255, 170, 0)])
preview_2 = CustomPreview(Geometry=move_3.Geometry, Material=gradient_3)
preview_3 = CustomPreview(Geometry=area.Centroid, Material=gradient_4)

# ==== cluster Cluster
data = ClusterInput()
data_2 = Data(data)
data_3 = ClusterOutput(data_2)
bnd = Bounds(Numbers=data_2)
dedomain = DeconstructDomain(Domain=bnd)  # -> Start, End
S = ClusterOutput(dedomain.Start)
E = ClusterOutput(dedomain.End)

# ==== cluster Cluster_3
C = ClusterInput()
cluster = Cluster_2(C=C)
T = ClusterInput()
move = Move(Geometry=cluster, Motion=T)  # -> Geometry, Transform
srf = ClusterOutput(cluster)

# ==== cluster Cluster_4
geo = Geometry([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])
mesh = Mesh(geo)
mjoin = MeshJoin(Meshes=mesh)
M = ClusterOutput(mjoin)

# ==== cluster Cluster_2
C = ClusterInput()
circle = CircleCNR(Center=C, Normal=Vector(0, 0, 1), Radius=2)
srf = Surface(circle)
srf_2 = ClusterOutput(srf)
